# Dynamo graph hello_codex_rooms_2024.dyn "HelloCodexRooms"
# Sets the Comments parameter of all rooms to 'Hello Codex'.

python = Python(IsVisible=true, IsUpstreamVisible=true, IsSelected=false, ShowGeometry=true, Excluded=false, X=0, Y=0)  # CPython3
# ---------- python.python (24 lines) ----------
import clr
clr.AddReference("RevitServices")
from RevitServices.Persistence import DocumentManager
from RevitServices.Transactions import TransactionManager

clr.AddReference("RevitAPI")
from Autodesk.Revit.DB import BuiltInCategory, FilteredElementCollector

doc = DocumentManager.Instance.CurrentDBDocument

rooms = list(FilteredElementCollector(doc)
             .OfCategory(BuiltInCategory.OST_Rooms)
             .WhereElementIsNotElementType())

TransactionManager.Instance.EnsureInTransaction(doc)
updated = []
for room in rooms:
    param = room.LookupParameter("Comments")
    if param and not param.IsReadOnly:
        param.Set("Hello Codex")
        updated.append(room)
TransactionManager.Instance.TransactionTaskDone()

OUT = updated
# ----------------------------------------
